# Grasshopper definition RDGrid.gh (Grasshopper 1.0.7)

number_slider = Slider(30, range=0..30)
file_path = FilePath("G:\Mi unidad\Barcelona MPDA\Universidad\2nd Semester\Algorithmics in Techonology\AT AP\GitHub\MPDA_AT.AP\RDGrid.py")
number_slider_2 = Slider(10, range=0..200)
number_slider_3 = Slider(10, range=0..200)
construct_domain = ConstructDomain(DomainStart=Slider(0, range=0..10), DomainEnd=number_slider)
construct_domain_2 = ConstructDomain(DomainStart=Slider(0, range=0..10), DomainEnd=Slider(30, range=0..30))
read_file = ReadFile(File=file_path, PerLineParse=False)
division = Division(A=number_slider, B=number_slider_3)
ghpython_script = GhPythonScript(
    Code=read_file,
    Width=number_slider_3,
    Heigth=number_slider_2,
    Iterations=Slider(100, range=0..100),
    XSize=construct_domain,
    YSize=construct_domain_2)  # -> Out, simplify(Previous), simplify(Final), Mesh
square = Square(Plane=PlaneXY(0, 0, 0), Size=division, ExtentX=number_slider_3, ExtentY=number_slider_2)  # -> Cells, Points
panel = Panel(ghpython_script.Out)
panel_2 = Panel(ghpython_script.Previous)
area = Area(Geometry=square.Cells)  # -> Area, Centroid
panel_3 = Panel(ghpython_script.Final)
average = Average(Input=flatten(area.Centroid))
rotate_3d = Rotate3D(Geometry=square.Cells, Angle=degrees(180), Center=average, Axis=Vector(1, 0, 0))  # -> Geometry, Transform
area_2 = Area(Geometry=rotate_3d.Geometry)  # -> Area, Centroid
point = Point(simplify(graft(area_2.Centroid)))
justification = Justification(2)
justification_2 = Justification(8)
text_tag_3d = TextTag3D(Location=point, Text=ghpython_script.Final, Size=1, Justification=[justification, justification_2])
